% Simulink data dictionary DCCurEst.sldd

Tonoff = Simulink.Parameter(-3.7e-6, StorageClass="ConstVolatile", DataType="single")
Tonoff2 = Simulink.Parameter(3.7e-6, StorageClass="ConstVolatile", DataType="single")
DeadPrd = Simulink.Parameter(4.0e-6, StorageClass="ConstVolatile", DataType="single")