% Simulink data dictionary bldc.sldd
% references DCCurEst.sldd

f32_P_MaxTrq_Nm = Simulink.Parameter(1500, StorageClass="ConstVolatile", DataType="single")
f32_P_MinTrq_Nm = Simulink.Parameter(-1500, StorageClass="ConstVolatile", DataType="single")
f32_P_SpdPosKp = Simulink.Parameter(100, StorageClass="ConstVolatile", DataType="single")
f32_P_SpdPosKi = Simulink.Parameter(10, StorageClass="ConstVolatile", DataType="single")
f32_P_SpdNegKp = Simulink.Parameter(100, StorageClass="ConstVolatile", DataType="single")
f32_P_SpdNegKi = Simulink.Parameter(10, StorageClass="ConstVolatile", DataType="single")
f32_P_SpdPoslimit_rpm = Simulink.Parameter(6000, StorageClass="ConstVolatile", DataType="single")
f32_P_SpdNeglimit_rpm = Simulink.Parameter(-6000, StorageClass="ConstVolatile", DataType="single")
f32_P_FwcCurMax_A = Simulink.Parameter(54.2, StorageClass="ConstVolatile", DataType="single")
u16_P_MotorPair = Simulink.Parameter(4, StorageClass="ConstVolatile", DataType="uint16")
f32_P_AngleCompVol = Simulink.Parameter(1.5, StorageClass="ConstVolatile", DataType="single")
f32_P_IdPiMax = Simulink.Parameter(0.95, StorageClass="ConstVolatile", DataType="single")
f32_P_AngleCompCur = Simulink.Parameter(5461, StorageClass="ConstVolatile", DataType="single")
f32_P_IdKp = Simulink.Parameter(0.02, StorageClass="ConstVolatile", DataType="single")
f32_P_IqKi = Simulink.Parameter(0.00010825, StorageClass="ConstVolatile", DataType="single")
f32_P_IdKi = Simulink.Parameter(0.00010825, StorageClass="ConstVolatile", DataType="single")
f32_P_IdPiMin = Simulink.Parameter(-0.95, StorageClass="ConstVolatile", DataType="single")
f32_P_CurMax_A = Simulink.Parameter(43, StorageClass="ConstVolatile", DataType="single")
f32_P_SpeedPiMax = Simulink.Parameter(1.5, StorageClass="ConstVolatile", DataType="single")
f32_P_SpeedPiMin = Simulink.Parameter(-1.5, StorageClass="ConstVolatile", DataType="single")
f32_P_DeadPrd = Simulink.Parameter(80, StorageClass="ConstVolatile", DataType="uint32")
f32_P_fwcKi = Simulink.Parameter(0.3, StorageClass="ConstVolatile", DataType="single")
f32_P_fwcKp = Simulink.Parameter(11, StorageClass="ConstVolatile", DataType="single")
f32_P_SpeedKi = Simulink.Parameter(2.5e-6, StorageClass="ConstVolatile", DataType="single")
f32_P_Modulation = Simulink.Parameter(0.95, StorageClass="ConstVolatile", DataType="single")
f32_P_MotorPhi = Simulink.Parameter(0.0026, StorageClass="ConstVolatile", DataType="single")
f32_P_SpeedKp = Simulink.Parameter(0.02, StorageClass="ConstVolatile", DataType="single")
f32_P_IdInIF_A = Simulink.Parameter(-5, StorageClass="ConstVolatile", DataType="single")
f32_P_Uqmax = Simulink.Parameter(0.955, StorageClass="ConstVolatile", DataType="single")
AngleOut = Simulink.Signal(StorageClass="ExportedGlobal", DataType="uint16")
f32_P_IdqFilter = Simulink.Parameter(1250, StorageClass="ConstVolatile", DataType="single")
f32_P_IqKp = Simulink.Parameter(0.02, StorageClass="ConstVolatile", DataType="single")
f32_P_FwcFilter = Simulink.Parameter(500, StorageClass="ConstVolatile", DataType="single")
f32_P_PWMFreq = Simulink.Parameter(10000, StorageClass="ConstVolatile", DataType="single")

Duty = Simulink.Bus(HeaderFile="Rte_Type.h")
  f32_DutyUon: single
  f32_DutyVon: single
  f32_DutyWon: single

QuickStart_50024_9_5_18_23_15535 = Simulink.ConfigSet(StartTime="0", StopTime="5", FixedStep="0.0001", Solver="FixedStepDiscrete", ProdHWDeviceType="Infineon->TriCore", SystemTargetFile="autosar.tlc", TargetLang="C")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